# Dynamo graph PlaceAllWallTypes.dyn (Dynamo 2.6.0.8481)
# packages: Clockwork for Dynamo 2.x 2.3.0

code_block = CodeBlock { "WallType"; }
byName = Custom[ElementType.ByName](name=code_block)  # package Clockwork for Dynamo 2.x; Retrieves an element type by its name - to be used with the OOTB node "All Elements of Type".

# group: Collect all wall types
all_elements_of_type = ElementsOfType(element_type=byName)

# group: Build curves to use
count = List.Count(list=all_elements_of_type)
code_block_2 = CodeBlock(wallTypes=count) { 0..#wallTypes..5; [0,20]; }
byCoordinates = Point.ByCoordinates(x=code_block_2.out0, y=code_block_2.out1, lacing=CrossProduct)
byBestFitThroughPoints = Line.ByBestFitThroughPoints(bestFitPoints=byCoordinates)

code_block_3 = CodeBlock { 10; }

# group: Get bottom level
code_block_4 = CodeBlock { "Levels"; }
byName_2 = Category.ByName(name=code_block_4)
all_elements_of_category = ElementsOfCategory(Category=byName_2)
elevation = Level.Elevation(level=all_elements_of_category)
sortByKey = List.SortByKey(list=all_elements_of_category, keys=elevation)
firstItem = List.FirstItem(list=sortByKey.sorted_list)

byCurveAndHeight = Wall.ByCurveAndHeight(curve=byBestFitThroughPoints, height=code_block_3, level=firstItem, wallType=all_elements_of_type)
