# Dynamo graph Place All WallTypes.dyn (Dynamo 2.13.1.3887)
# author: John P.
# Place all wall types found in the library.

# group: Collect all wall types
code_block = CodeBlock { DSCore.Types.FindTypeByNameInAssembly("WallType", "RevitAPI"); }
all_elements_of_type = ElementsOfType(element_type=code_block)

# group: Build curves to use
count = List.Count(list=all_elements_of_type)
code_block_2 = CodeBlock(wallTypes=count) { 0..#wallTypes..5; [0,20]; }
byCoordinates = Point.ByCoordinates(x=code_block_2.out0, y=code_block_2.out1, lacing=CrossProduct)
byBestFitThroughPoints = Line.ByBestFitThroughPoints(bestFitPoints=byCoordinates)
code_block_3 = CodeBlock { 10; }

# group: Get bottom level
code_block_4 = CodeBlock { "Levels"; }
byName = Category.ByName(name=code_block_4)
all_elements_of_category = ElementsOfCategory(Category=byName)
elevation = Level.Elevation(level=all_elements_of_category)
sortByKey = List.SortByKey(list=all_elements_of_category, keys=elevation)
firstItem = List.FirstItem(list=sortByKey.sortedList)

byCurveAndHeight = Wall.ByCurveAndHeight(curve=byBestFitThroughPoints, height=code_block_3, level=firstItem)  # unwired: wallType
function_apply = ApplyFunction(function=byCurveAndHeight, argument0=all_elements_of_type)
