# Dynamo graph Override Color.dyn "OverrideColor" (Dynamo 2.6.0.8481)
# packages: Rhythm 2020.9.8

code_block = CodeBlock { "Walls"; }
byName = Category.ByName(name=code_block)
isolated_pick_model_elements = Custom[Isolated Pick Model Elements](category=byName)  # package Rhythm; This allows a multiple selection of elements of specified category.
color_palette = ColorPalette({R: 255, G: 99, B: 71, A: 255})
overrideColorInView = Element.OverrideColorInView(element=isolated_pick_model_elements, color=color_palette)
