# Dynamo graph ChartWallTypeUsage.dyn (Dynamo 2.6.0.8481)
# packages: Data-Shapes 2021.2.91

# group: Collect all walls and group by their respective wall type
code_block = CodeBlock { "Walls"; }
byName = Category.ByName(name=code_block)
all_elements_of_category = ElementsOfCategory(Category=byName)
elementType = Element.ElementType(element=all_elements_of_category)
groupByKey = List.GroupByKey(list=all_elements_of_category, keys=elementType)

# group: Name as the series, counts as the values
name = Element.Name(element=groupByKey.unique_keys)
count = List.Count(list=groupByKey.groups@L2)

# group: Build a snazzy UI
# note: Custom Package: Data-Shapes v.2021.2.91
pieChart = Custom[PieChart](series=name, values=count)  # package Data-Shapes; PieChart
code_block_2 = CodeBlock { 1; }
multipleinputform = Custom[MultipleInputForm ++](Inputs=pieChart, Toggle=code_block_2)  # package Data-Shapes; Create a form with multiple inputs. see www.data-shapes.net for tutorials and infos!
