# Dynamo graph AddPrefixOrSuffixToViews.dyn (Dynamo 2.13.1.3887)
# author: John P.
# Offers the ability to rename views (by selection in UI) with a prefix or suffix.
# packages: Data-Shapes 2022.2.103, Rhythm 2022.7.2, Clockwork for Dynamo 2.x 2.4.0

# group: Prefix input
code_block = CodeBlock { "Text to Add"; }
# note: Custom Node: Data-Shapesv.2022.2.103
textbox_data = Custom[TextBox Data](InputName=code_block)  # package Data-Shapes; Create Data for TextBox input in UI.MultipleInputForm ++ . Check out www.data-shapes.net for more informations

# group: Input
code_block_2 = CodeBlock { ["Prefix","Suffix"]; [true,false]; 0; }
# note: Custom Node: Data-Shapesv.2022.2.103
radiobuttons_data = Custom[RadioButtons Data](Keys=code_block_2.out0, Values=code_block_2.out1, DefaultValueIndex=code_block_2.out2)  # package Data-Shapes; Create radio buttons input for UI.MultipleInputForm ++ .

# group: Collect all views that are not templates
code_block_3 = CodeBlock { DSCore.Types.FindTypeByNameInAssembly("View", "RevitAPI"); }
all_elements_of_type = ElementsOfType(element_type=code_block_3)
# note: Yellow here is okay because dynamo freaks out for 3d view templates 🙄
isViewTemplate = View.IsViewTemplate(view=all_elements_of_type)
code_block_4 = CodeBlock { true; }
isNull = Object.IsNull()  # unwired: object
replaceByCondition = Replace(item=isViewTemplate, replaceWith=code_block_4, condition=isNull)
filterByBoolMask = List.FilterByBoolMask(list=all_elements_of_type, mask=replaceByCondition)

# group: Group the views by type
elementType = Element.ElementType(element=filterByBoolMask.out)
name = Element.Name(element=elementType)
groupByKey = List.GroupByKey(list=filterByBoolMask.out, keys=name)

# group: "Weave" lists together so we have headings
list_create = List.Create(item0=groupByKey.uniqueKeys, item1=groupByKey.groups)
transpose = List.Transpose(lists=list_create)
flatten = List.Flatten(list=transpose@L3)

# group: Views as tree view
code_block_5 = CodeBlock { true; }
# note: Custom Node: Data-Shapesv.2022.2.103
treeview_input = Custom[TreeView input](Data=flatten, FirstItemIsTitle=code_block_5)  # package Data-Shapes; Create a TreeView input for UI.MultipleInputForm ++ . Check out www.data-shapes.net for more infos and tips!

# group: Show our form
list_create_2 = List.Create(item0=textbox_data, item1=radiobuttons_data, item2=treeview_input)
code_block_6 = CodeBlock { 1; }
# note: Custom Node: Data-Shapesv.2022.2.103
multipleinputform = Custom[MultipleInputForm ++](Inputs=list_create_2, Toggle=code_block_6)  # package Data-Shapes; Create a form with multiple inputs. see www.data-shapes.net for tutorials and infos!

# group: Our outputs from our form
code_block_7 = CodeBlock(x=multipleinputform.User_Inputs)
# ---------- code_block_7.designscript (2 lines) ----------
//the views to rename
x[2];
# ----------------------------------------
code_block_8 = CodeBlock(x=multipleinputform.User_Inputs)
# ---------- code_block_8.designscript (3 lines) ----------
//our prefix
x[0];
"";
# ----------------------------------------
code_block_9 = CodeBlock(x=multipleinputform.User_Inputs)
# ---------- code_block_9.designscript (2 lines) ----------
//true for prefix, false for suffix
x[1];
# ----------------------------------------

# group: If there is a new prefix, then toggle
ne = code_block_8.out0 != code_block_8.out1
# note: Custom Node: Rhythmv.2022.7.2
ʳʰʸᵗʰᵐ_helpers_toggle = Rhythm.Helpers.Helpers.Toggle(obj=code_block_7, toggle=ne)

# group: Logic for setting either prefix or suffix
name_2 = Element.Name(element=ʳʰʸᵗʰᵐ_helpers_toggle)
code_block_10 = CodeBlock(text=code_block_8.out0, viewName=name_2) { text + viewName; viewName + text; }
# note: Custom Node: Rhythmv.2022.7.2
ʳʰʸᵗʰᵐ_helpers_thisorthat = Rhythm.Helpers.Helpers.ThisOrThat(obj1=code_block_10.out0, obj2=code_block_10.out1, toggle=code_block_9)
# note: Custom Node: Clockwork
setName = Custom[Element.SetName](element=ʳʰʸᵗʰᵐ_helpers_toggle, name=ʳʰʸᵗʰᵐ_helpers_thisorthat)  # package Clockwork for Dynamo 2.x; Gets the name of a given Revit element
