# Dynamo graph Override Color.dyn (Dynamo 2.13.1.3887)
# author: John P.
# Override selected walls with a selected color in the active view.
# packages: Data-Shapes 2022.2.103, Clockwork for Dynamo 2.x 2.4.0

# group: Input
code_block = CodeBlock { "Select Walls"; }
code_block_2 = CodeBlock { "Walls"; }
byName = Category.ByName(name=code_block_2)

# group: Input
# note: Custom Node: Data-Shapesv.2022.2.103
selectmodelelements_data = Custom[SelectModelElements Data](ButtonText=code_block, CategoryFilter=byName)  # package Data-Shapes; Creates a Revit element selection input for UI.MultipleInputForm++ . Check out www.data-shapes.net for more infos!
colorinput_data = Custom[ColorInput Data]()  # package Data-Shapes; Create a color selection input for UI.MultiInputForm++ . Check out www.data-shapes.net for more infos! Warning : Only works with Revit 2017
list_create = List.Create(item0=selectmodelelements_data, item1=colorinput_data)
code_block_3 = CodeBlock { true; }

# group: Action/UI
# note: Custom Node: Data-Shapesv.2022.2.103
multipleinputform = Custom[MultipleInputForm ++](Inputs=list_create, Toggle=code_block_3)  # package Data-Shapes; Create a form with multiple inputs. see www.data-shapes.net for tutorials and infos!

# group: Results
code_block_4 = CodeBlock(x=multipleinputform.User_Inputs) { x[0]; x[1]; }
# note: Custom Node: Clockwork
toDynamoColor = Custom[Color.ToDynamoColor](RevitColor=code_block_4.out1)  # package Clockwork for Dynamo 2.x; Converts Revit colors into Dynamo colors
overrideColorInView = Element.OverrideColorInView(element=code_block_4.out0, color=toDynamoColor)
