# Dynamo graph ChartWallTypeUsage.dyn (Dynamo 2.19.3.6394)
# author: John P.
# Create a pie chart (pushable to a drafting view) from the used wall types in the model.
# packages: Data-Shapes 2024.2.114

# group: Collect all walls and group by their respective wall type
code_block = CodeBlock { "Walls"; }
byName = Category.ByName(name=code_block)
all_elements_of_category = ElementsOfCategory(Category=byName)
code_block_2 = CodeBlock { "Revit.Elements.Wall"; }
removeIfNot = List.RemoveIfNot(list=all_elements_of_category, type=code_block_2)
elementType = Element.ElementType(element=removeIfNot)
groupByKey = List.GroupByKey(list=removeIfNot, keys=elementType)

# group: Name as the series, counts as the values
name = Element.Name(element=groupByKey.uniqueKeys)
count = List.Count(list=groupByKey.groups@L2)

# group: Build a snazzy UI
code_block_3 = CodeBlock { "Neat"; }
# note: Custom Node: Data-Shapesv.2022.2.103
pieChart = Custom[PieChart](series=name, values=count)  # package Data-Shapes; PieChart
code_block_4 = CodeBlock { 1; }
multipleinputform = Custom[MultipleInputForm ++](ButtonText_optional=code_block_3, Inputs=pieChart, Toggle=code_block_4)  # package Data-Shapes; Create a form with multiple inputs. see www.data-shapes.net for tutorials and infos!
