# Dynamo graph Inputs.dyn (Dynamo 4.0.2.3852)

categories = Categories()  # nothing selected; graph input
all_elements_of_category = ElementsOfCategory(Category=categories)
count = List.Count(list=all_elements_of_category)
string_from_object = FromObject(object=count)
watch = Watch(string_from_object)  # graph output
watch_2 = Watch(all_elements_of_category)  # graph output
